# Grasshopper definition Unity AR Brick Wall.gh (Grasshopper 1.0.8)
# plug-ins: jSwan, firehopper

panel = Panel("https://geocoris-61934-default-rtdb.europe-west1.firebasedatabase.app/")
trigger = Trigger(Interval=2000, TimerInterval=2000, Target=toggle)
toggle = BooleanToggle(True)
fhget = FirehopperGET(APIKey="V4wbx1APT3FIGXolyeL4yoQQ3RgAMfQTygaoNP1o", DatabaseURL=panel, DatabaseNode="control_points/", Trigger=toggle)
dejsonkv = DeserializeKeysAndValues(JSON=fhget)  # -> Key, Value
dejsonkv_2 = DeserializeKeysAndValues(JSON=dejsonkv.Value)  # -> Key, Value
panel_2 = Panel(fhget)
item = ListItem(List=dejsonkv_2.Value, Index=1, Wrap=True)
partition = PartitionList(List=flatten(item), Size="4")
dejsonkv_3 = DeserializeKeysAndValues(JSON=partition)  # -> Key, Value
item_2 = ListItem(List=dejsonkv_3.Value, Index=0, Wrap=True)  # -> Item, Item1, Item2
pt = ConstructPoint(XCoordinate=item_2.Item, YCoordinate=item_2.Item1, ZCoordinate=item_2.Item2)
pshift = ShiftPaths(Data=pt, Offset=-1)
division = Division(A=pshift, B=2)
intcrv = Interpolate(Vertices=division, Degree=3, Periodic=False, KnotStyle=1)  # -> Curve, Length, Domain
loft = Loft(
    Curves=flatten(intcrv.Curve),
    Options={Adjust=False, Closed=False, LoftEnds=0, LoftSimp=0, LoftType=0, Rebuild=10, Refit=0.01})
bang = ExplodeTree(Data=division)  # -> Branch0, Branch1, Branch2
rec = DataRecorder(bang.Branch0, DataLimit=6, RecordData=True)
partition_2 = PartitionList(List=rec, Size=3)
flip = FlipMatrix(Data=partition_2)
item_3 = ListItem(List=flip, Index=0, Wrap=True)  # -> Item, Item1
equals = Equality(FirstNumber=item_3.Item, SecondNumber=item_3.Item1)  # -> Equality, Inequality
ma = MassAddition(Input=flatten(equals.Equality))  # -> Result, PartialResults
pt_2 = Point(<point referenced from the Rhino model>)
pt_3 = Point(<point referenced from the Rhino model>)
pt_4 = Point(<point referenced from the Rhino model>)
pt_5 = Point(<point referenced from the Rhino model>)
pt_6 = Point(<point referenced from the Rhino model>)
pt_7 = Point(<point referenced from the Rhino model>)
pt_8 = Point(<point referenced from the Rhino model>)
pt_9 = Point(<point referenced from the Rhino model>)
pt_10 = Point(<point referenced from the Rhino model>)
pt_11 = Point(<point referenced from the Rhino model>)
pt_12 = Point(<point referenced from the Rhino model>)
pt_13 = Point(<point referenced from the Rhino model>)
merge = Merge(Data1=pt_2, Data2=pt_3, Data3=pt_4, Data4=pt_5)
merge_2 = Merge(Data1=pt_6, Data2=pt_8, Data3=pt_7, Data4=pt_9)
merge_3 = Merge(Data1=pt_10, Data2=pt_11, Data3=pt_12, Data4=pt_13)
number_slider = Slider(29, range=0..50)
number_slider_2 = Slider(5, range=0..50)
avr = Average(Input=merge_2)
addition = Addition(A=number_slider_2, B=Slider(0, range=0..100))
intcrv_2 = Interpolate(Vertices=merge_3, Degree=3, Periodic=False, KnotStyle=1)  # -> Curve, Length, Domain
pdecon = Deconstruct(Point=avr)  # -> XComponent, YComponent, ZComponent
project = Project(Geometry=merge, Plane=PlaneXY(0, 0, 0))  # -> Geometry, Transform
addition_2 = Addition(A=number_slider, B=Slider(2, range=0..100))
box = DomainBox(Base=PlaneXY(0, 0, 0), X=number_slider, Y=Slider(14, range=0..50), Z=number_slider_2)
division_2 = Division(A=pdecon.ZComponent, B=addition)
round = Round(Number=division_2)  # -> Nearest, Floor, Ceiling
mesh = MeshBrep(
    Brep=box,
    Settings={GridMaxCount=0, GridMinCount=16, JaggedSeams=False, MaxEdgeLength=0, MinEdgeLength=0.0001, MinTolerance=0, Refine=True, RefineAngle=0, RelativeTolerance=0.65, SimplePlanes=True, Tolerance=0})
multiplication = Multiplication(A=round.Floor, B=addition)
pt_14 = ConstructPoint(XCoordinate=pdecon.XComponent, YCoordinate=pdecon.YComponent, ZCoordinate=multiplication)
project_2 = Project(Geometry=merge_2, Plane=pt_14)  # -> Geometry, Transform
intcrv_3 = Interpolate(Vertices=project.Geometry, Degree=3, Periodic=False, KnotStyle=1)  # -> Curve, Length, Domain
intcrv_4 = Interpolate(Vertices=project_2.Geometry, Degree=3, Periodic=False, KnotStyle=1)  # -> Curve, Length, Domain
loft_2 = Loft(
    Curves=[intcrv_3.Curve, intcrv_4.Curve],
    Options={Adjust=False, Closed=False, LoftEnds=0, LoftSimp=0, LoftType=0, Rebuild=10, Refit=0.01})
merge_4 = Merge(Data1=intcrv_3.Curve, Data2=intcrv_4.Curve)
len = Length(Curve=merge_4)
division_3 = Division(A=len, B=addition_2)
round_2 = Round(Number=division_3)  # -> Nearest, Floor, Ceiling
sort = SortList(Keys=flatten(round_2.Nearest))  # -> Keys, ValuesA
item_4 = ListItem(List=sort.Keys, Index=0, Wrap=True)
multiplication_2 = Multiplication(A=item_4, B=2)
mesh_uv = MeshSurface(Surface=loft_2, UCount=round.Floor, VCount=multiplication_2, Overhang=True, Equalize=False)
demesh = DeconstructMesh(Mesh=mesh_uv)  # -> Vertices, Faces, Colours, Normals
facen = FaceNormals(Mesh=mesh_uv)  # -> Centers, Normals
addition_3 = Addition(A=multiplication_2, B=1)
partition_3 = PartitionList(List=demesh.Vertices, Size=addition_3)
partition_4 = PartitionList(List=facen.Normals, Size=multiplication_2)
cull_i = CullIndex(List=partition_3, Indices=0, Wrap=True)
split = SplitTree(Data=simplify(cull_i), Masks=flatten("{0,2,4...}"))  # -> Positive, Negative
split_2 = SplitTree(Data=simplify(partition_4), Masks=flatten("{0,2,4...}"))  # -> Positive, Negative
cull = CullPattern(List=split.Negative, CullPattern=invert([False, True]))
cull_2 = CullPattern(List=split_2.Negative, CullPattern=invert([False, True]))
cull_3 = CullPattern(List=split.Positive, CullPattern=[False, True])
cull_4 = CullPattern(List=split_2.Positive, CullPattern=[False, True])
merge_5 = Merge(Data1=cull_3, Data2=cull)
merge_6 = Merge(Data1=cull_4, Data2=cull_2)
Z = UnitZ(Factor=1)
xprod = CrossProduct(VectorA=merge_6, VectorB=Z, Unitize=False)  # -> Vector, Length
Z_2 = UnitZ(Factor=1)
vrot = Rotate(Vector=xprod.Vector, Axis=Z_2, Angle="90")
pl = ConstructPlane(Origin=merge_5, XAxis=xprod.Vector, YAxis=vrot)
pull = PullPoint(Point=pl, Geometry=intcrv_2.Curve, ClosestOnly=True)  # -> ClosestPoint, Distance
bnd = Bounds(Numbers=pull.Distance)
remap = RemapNumbers(Value=pull.Distance, Source=bnd, Target=Domain(0, 1))  # -> Mapped, Clipped
graph = GraphMapper(
    remap.Mapped,
    x0=0,
    x1=1,
    y0=0,
    y1=1,
    container_name="Bezier",
    cpx=[0, 0.206031695, 0.1615919024, 1],
    cpy=[0, 0.7509588599, 0.8597925305, 1])
bnd_2 = Bounds(Numbers=graph)
dom = ConstructDomain(DomainStart=Slider(30, range=0..90), DomainEnd=Slider(0, range=0..100))
remap_2 = RemapNumbers(Value=graph, Source=bnd_2, Target=dom)  # -> Mapped, Clipped
rad = Radians(Degrees=remap_2.Mapped)
prot = RotatePlane(Plane=pl, Angle=rad)
orient = Orient(Geometry=mesh, Source=PlaneXY(0, 0, 0), Target=prot)  # -> Geometry, Transform
preview = CustomPreview(
    Geometry=orient.Geometry,
    Material={diffuse=RGB(221, 160, 221), emission=RGB(66, 48, 66), shine=0.5, specular=RGB(255, 255, 255), transparency=0})
demesh_2 = DeconstructMesh(Mesh=orient.Geometry)  # -> Vertices, Faces, Colours, Normals
pdecon_2 = Deconstruct(Point=graft(demesh_2.Vertices))  # -> XComponent, YComponent, ZComponent
panel_3 = Panel(demesh_2.Faces)
merge_7 = Merge(Data1=pdecon_2.XComponent, Data2=pdecon_2.YComponent, Data3=pdecon_2.ZComponent)
panel_4 = Panel("""x
y
z""")
fhkeyvaluepair = FirehopperKeyValuePairGenerator(ListOfKeys=panel_4, ListOfValues=merge_7)
fhkeyvaluepair_2 = FirehopperKeyValuePairGenerator(ListOfKeys="Quads", ListOfValues=panel_3)
pshift_2 = ShiftPaths(Data=fhkeyvaluepair, Offset=-1)
lng = ListLength(List=pshift_2)
series = Series(Start=0, Step=1, Count=lng)
concat = Concatenate(FragmentA="point", FragmentB=series)  # -> simplify(Result)
fhkeyvaluepair_3 = FirehopperKeyValuePairGenerator(ListOfKeys=concat, ListOfValues=pshift_2)
pshift_3 = ShiftPaths(Data=fhkeyvaluepair_3, Offset=-1)
lng_2 = ListLength(List=pshift_3)
series_2 = Series(Start=0, Step=1, Count=lng_2)
concat_2 = Concatenate(FragmentA="brick", FragmentB=series_2)  # -> simplify(Result)
fhkeyvaluepair_4 = FirehopperKeyValuePairGenerator(ListOfKeys=concat_2, ListOfValues=pshift_3)
lng_3 = ListLength(List=fhkeyvaluepair_4)
series_3 = Series(Start=0, Step=1, Count=lng_3)
concat_3 = Concatenate(FragmentA="column", FragmentB=series_3)  # -> simplify(Result)
fhkeyvaluepair_5 = FirehopperKeyValuePairGenerator(ListOfKeys=concat_3, ListOfValues=fhkeyvaluepair_4)
fhput = FirehopperPUT(KeyValuePair=fhkeyvaluepair_5, Trigger=Toggle(False))
