# Grasshopper definition Unity AR Brick Wall.gh (Grasshopper 1.0.8)

pt = Point(<point referenced from the Rhino model>)
pt_2 = Point(<point referenced from the Rhino model>)
pt_3 = Point(<point referenced from the Rhino model>)
pt_4 = Point(<point referenced from the Rhino model>)
pt_5 = Point(<point referenced from the Rhino model>)
pt_6 = Point(<point referenced from the Rhino model>)
pt_7 = Point(<point referenced from the Rhino model>)
pt_8 = Point(<point referenced from the Rhino model>)
pt_9 = Point(<point referenced from the Rhino model>)
pt_10 = Point(<point referenced from the Rhino model>)
pt_11 = Point(<point referenced from the Rhino model>)
pt_12 = Point(<point referenced from the Rhino model>)
merge = Merge(Data1=pt, Data2=pt_2, Data3=pt_3, Data4=pt_4)
merge_2 = Merge(Data1=pt_5, Data2=pt_7, Data3=pt_6, Data4=pt_8)
merge_3 = Merge(Data1=pt_9, Data2=pt_10, Data3=pt_11, Data4=pt_12)
number_slider = Slider(29, range=0..50)
number_slider_2 = Slider(5, range=0..50)
avr = Average(Input=merge_2)
addition = Addition(A=number_slider_2, B=Slider(0, range=0..100))
project = Project(Geometry=merge, Plane=PlaneXY(0, 0, 0))  # -> Geometry, Transform
intcrv = Interpolate(Vertices=merge_3, Degree=3, Periodic=False, KnotStyle=1)  # -> Curve, Length, Domain
pdecon = Deconstruct(Point=avr)  # -> XComponent, YComponent, ZComponent
addition_2 = Addition(A=number_slider, B=Slider(2, range=0..100))
box = DomainBox(Base=PlaneXY(0, 0, 0), X=number_slider, Y=Slider(14, range=0..50), Z=number_slider_2)
division = Division(A=pdecon.ZComponent, B=addition)
round = Round(Number=division)  # -> Nearest, Floor, Ceiling
mesh = MeshBrep(
    Brep=box,
    Settings={GridMaxCount=0, GridMinCount=16, JaggedSeams=False, MaxEdgeLength=0, MinEdgeLength=0.0001, MinTolerance=0, Refine=True, RefineAngle=0, RelativeTolerance=0.65, SimplePlanes=True, Tolerance=0})
multiplication = Multiplication(A=round.Floor, B=addition)
pt_13 = ConstructPoint(XCoordinate=pdecon.XComponent, YCoordinate=pdecon.YComponent, ZCoordinate=multiplication)
project_2 = Project(Geometry=merge_2, Plane=pt_13)  # -> Geometry, Transform
intcrv_2 = Interpolate(Vertices=project.Geometry, Degree=3, Periodic=False, KnotStyle=1)  # -> Curve, Length, Domain
intcrv_3 = Interpolate(Vertices=project_2.Geometry, Degree=3, Periodic=False, KnotStyle=1)  # -> Curve, Length, Domain
loft = Loft(
    Curves=[intcrv_2.Curve, intcrv_3.Curve],
    Options={Adjust=False, Closed=False, LoftEnds=0, LoftSimp=0, LoftType=0, Rebuild=10, Refit=0.01})
merge_4 = Merge(Data1=intcrv_2.Curve, Data2=intcrv_3.Curve)
len = Length(Curve=merge_4)
division_2 = Division(A=len, B=addition_2)
round_2 = Round(Number=division_2)  # -> Nearest, Floor, Ceiling
sort = SortList(Keys=flatten(round_2.Nearest))  # -> Keys, ValuesA
item = ListItem(List=sort.Keys, Index=0, Wrap=True)
multiplication_2 = Multiplication(A=item, B=2)
mesh_uv = MeshSurface(Surface=loft, UCount=round.Floor, VCount=multiplication_2, Overhang=True, Equalize=False)
demesh = DeconstructMesh(Mesh=mesh_uv)  # -> Vertices, Faces, Colours, Normals
facen = FaceNormals(Mesh=mesh_uv)  # -> Centers, Normals
addition_3 = Addition(A=multiplication_2, B=1)
partition = PartitionList(List=demesh.Vertices, Size=addition_3)
partition_2 = PartitionList(List=facen.Normals, Size=multiplication_2)
cull_i = CullIndex(List=partition, Indices=0, Wrap=True)
split = SplitTree(Data=simplify(cull_i), Masks=flatten("{0,2,4...}"))  # -> Positive, Negative
split_2 = SplitTree(Data=simplify(partition_2), Masks=flatten("{0,2,4...}"))  # -> Positive, Negative
cull = CullPattern(List=split.Negative, CullPattern=invert([False, True]))
cull_2 = CullPattern(List=split_2.Negative, CullPattern=invert([False, True]))
cull_3 = CullPattern(List=split.Positive, CullPattern=[False, True])
cull_4 = CullPattern(List=split_2.Positive, CullPattern=[False, True])
merge_5 = Merge(Data1=cull_3, Data2=cull)
merge_6 = Merge(Data1=cull_4, Data2=cull_2)
Z = UnitZ(Factor=1)
xprod = CrossProduct(VectorA=merge_6, VectorB=Z, Unitize=False)  # -> Vector, Length
Z_2 = UnitZ(Factor=1)
vrot = Rotate(Vector=xprod.Vector, Axis=Z_2, Angle="90")
pl = ConstructPlane(Origin=merge_5, XAxis=xprod.Vector, YAxis=vrot)
pull = PullPoint(Point=pl, Geometry=intcrv.Curve, ClosestOnly=True)  # -> ClosestPoint, Distance
bnd = Bounds(Numbers=pull.Distance)
remap = RemapNumbers(Value=pull.Distance, Source=bnd, Target=Domain(0, 1))  # -> Mapped, Clipped
graph = GraphMapper(
    remap.Mapped,
    x0=0,
    x1=1,
    y0=0,
    y1=1,
    container_name="Bezier",
    cpx=[0, 0.206031695, 0.1615919024, 1],
    cpy=[0, 0.7509588599, 0.8597925305, 1])
bnd_2 = Bounds(Numbers=graph)
dom = ConstructDomain(DomainStart=Slider(30, range=0..90), DomainEnd=Slider(0, range=0..100))
remap_2 = RemapNumbers(Value=graph, Source=bnd_2, Target=dom)  # -> Mapped, Clipped
rad = Radians(Degrees=remap_2.Mapped)
prot = RotatePlane(Plane=pl, Angle=rad)
orient = Orient(Geometry=mesh, Source=PlaneXY(0, 0, 0), Target=prot)  # -> Geometry, Transform
preview = CustomPreview(
    Geometry=orient.Geometry,
    Material={diffuse=RGB(221, 160, 221), emission=RGB(66, 48, 66), shine=0.5, specular=RGB(255, 255, 255), transparency=0})
